# Dynamo custom node JournalFiles.Cleanup.dyf (Dynamo 0.9.0.3067)
# category: DynamoAutomation.Journal.Actions
# Moves all journal files created during a batch-processing operation to a specified directory

executionDone = Input()
generatedJournalFiles = Input(generatedJournalFiles : string[])
directoryName = FilePath.DirectoryName(generatedJournalFiles)
firstItem = List.FirstItem(directoryName)
fromPath = DirectoryObject(firstItem)  # "Directory.FromPath"
contents = Directory.Contents(fromPath)
string = StringInput("[\w\s:\\]+journal.[0-9]+.txt")
matchRegularExpression = Custom[String.MatchRegularExpression](RegEx=string, str=contents)  # Determines if a regular expression matches a string (or a list of strings) and returns a boolean value (or a list, depending on the input). The syntax for regular expressions is explained at http://ironpython-test.readthedocs.org/en/latest/howto/regex.html
filterByBoolMask = List.FilterByBoolMask(list=contents, mask=matchRegularExpression)
join = List.Join(generatedJournalFiles, filterByBoolMask.in)
code_block = CodeBlock(execution_done=executionDone, paths=join)
# ---------- code_block.designscript (5 lines) ----------
// We're using this nifty device to ensure that
// moving the files will only happen
// once all the models have been processed
passthrough = {execution_done, paths};
passthrough[1];
# ----------------------------------------
destinationDirectory = Input(destinationDirectory : string)
replace = String.Replace(str=join, searchFor=firstItem, replaceWith=destinationDirectory)
overwriteExistingFiles = Input(overwriteExistingFiles : bool = true)
move = File.Move(code_block.out1, replace, overwriteExistingFiles)
Output = Output(move)  # ""
