# Dynamo graph A1 - Sandbox.dyn (Dynamo 0.8.3.2514)

# group: INPUTS
directory_path_revit_models = Directory("C:\Users\adieckmann\Documents\GitHub\DynamoAutomation\revit-models\2015\dir1")
file_path_dynamo_file = Filename("C:\Users\adieckmann\Documents\GitHub\DynamoAutomation\scenarios\Revit\2016\CountWalls.dyn")
revit_version = StringInput("2016")

# group: Create list of Revit files
fromPath = DirectoryObject(directory_path_revit_models)  # "Directory.FromPath"
code_block = CodeBlock { "*.rvt"; }
contents = Directory.Contents(fromPath, code_block)

# group: Create journal files
byVersion = Custom[RevitAddinsPath.ByVersion](RevitVersion=revit_version)  # Returns the path of Revit Addins folder based on a given Revit version
string = StringInput("\")
count = List.Count(contents)
code_block_2 = CodeBlock(n=count) { 1..n; }
string_from_object = FromObject(code_block_2)
code_block_3 = CodeBlock(jdir=byVersion, delimiter=string, n=string_from_object)
# ---------- code_block_3.designscript (2 lines) ----------
// Create file name for journal file
jdir + delimiter + "DynamoJournalFile_" + n + ".txt";
# ----------------------------------------
byWorkspacePath = Dynamo.Automation.Journal.ByWorkspacePath(contents, file_path_dynamo_file, code_block_3)

# group: Batch-process Revit files
byVersion_2 = Custom[RevitExecutablePath.ByVersion](RevitVersion=revit_version)  # Returns the path of Revit.exe based on a given Revit version
byPathAndArguments = Dynamo.Automation.Process.ByPathAndArguments(byVersion_2)
map = List.Map(list=byWorkspacePath, f_x=byPathAndArguments)
